# Grasshopper definition shoe_box_energy_model.gh (Grasshopper 1.0.7)

# ---- group: Dynamically Chage Glazing Ratio
number_slider = Slider(0.4, range=0.1..1.1)

# ----
# Create Honeybee Model
panel = Panel("outdoors")
geo = Geometry([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])
geo_2 = Geometry(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)
face = HBFace(geo=geo, bc=panel)  # -> report, faces; plug-in component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
face_2 = HBFace(geo=geo_2, bc="adiabatic")  # -> report, faces; plug-in component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
aperturesbyratio = HBAperturesByRatio(hb_objs=flatten(face.faces), ratio=number_slider, run=Toggle(True))  # -> report, hb_objs; plug-in component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
room = HBRoom(
    faces=flatten([face_2.faces, aperturesbyratio.hb_objs]),
    name="Office Shoe Box",
    program="2013::MidriseApartment::Apartment",
    constr_set="2013::ClimateZone5::SteelFramed",
    conditioned=True)  # -> report, room; plug-in component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
concat = Concatenate(FragmentA="ShoeBox", FragmentB=number_slider)
model = HBModel(rooms=flatten(room.room), name=concat)  # -> report, model; plug-in component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

# ----
# Request Outputs
toggle = BooleanToggle(True)
simoutput = HBSimulationOutput(zone_energy_use=toggle, comfort_metrics=toggle)  # -> report, sim_output; plug-in component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
simpar = HBSimulationParameter(output=simoutput.sim_output, timestep=6)  # -> sim_par; plug-in component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

# ----
# Download EPW File
panel_2 = Panel("https://www.energyplus.net/weather-download/north_and_central_america_wmo_region_4/USA/MA/USA_MA_Boston-Logan.Intl.AP.725090_TMY3/all")
downloadweather = LadybugPlus_DownloadWeather(weather_URL=panel_2)  # -> epw_file, stat_file, ddy_file; plug-in component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

connect_to_run__to_only_write_idf = Panel("2")
toggle_2 = BooleanToggle(False)
modeltoosm = HBModelToOSM(model=model.model, epw_file=downloadweather.epw_file, sim_par=simpar, write=toggle_2, run=toggle_2)  # -> report, jsons, osw, osm, idf, sql, zsz, rdd, html; plug-in component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

# ----
# Optionally Execute Simulations in Parallel
data = Data(modeltoosm.osw)
data_2 = Data(downloadweather.epw_file)
data_3 = Data(modeltoosm.idf)
rec = DataRecorder(data, DataLimit=-10, RecordData=True)
rec_2 = DataRecorder(data_3, DataLimit=-10, RecordData=True)
runosw = HBRunOSW(osw=rec, epw_file=data_2, parallel=Toggle(True), translate=Toggle(False))  # -> report, osm, idf, sql, zsz, rdd, html; plug-in component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
runidf = HBRunIDF(idf=rec_2, epw_file=data_2, parallel=Toggle(True), run=Toggle(False))  # -> report, sql, zsz, rdd, html; plug-in component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

# ----
# Visualize Results
roomenergyresult = HBReadRoomEnergyResult(sql=modeltoosm.sql)  # -> cooling, heating, lighting, electric_equip, gas_equip, fan_electric, pump_electric, people_gain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; plug-in component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
hourlyplot = LadybugPlus_HourlyPlot(data=roomenergyresult.heating)  # -> report, mesh, legend, borders, labels, title; plug-in component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
